# Grasshopper definition generate_calibration_frames.ghx (Grasshopper 1.0.7)

number_slider = Slider(-1.3, range=-1.5..1)
# R2
number_slider_2 = Slider(-0.8, range=-1..1)
multiplication = Multiplication(A=number_slider_2, B="pi")
multiplication_2 = Multiplication(A=Slider(0.8, range=-1..1), B="pi")
multiplication_3 = Multiplication(A=Slider(-1.3, range=-1.5..1), B="pi")
multiplication_4 = Multiplication(A=number_slider, B="pi")

# ----
# R1
number_slider_3 = Slider(-0.8, range=-1..1)
number_slider_4 = Slider(-1.3, range=-1.5..1)
multiplication_5 = Multiplication(A=number_slider_3, B="pi")
multiplication_6 = Multiplication(A=Slider(-0.1, range=-1..1), B="pi")
multiplication_7 = Multiplication(A=Slider(-1.3, range=-1.5..1), B="pi")
multiplication_8 = Multiplication(A=number_slider_4, B="pi")

dom = ConstructDomain(DomainStart=multiplication, DomainEnd=multiplication_2)
dom_2 = ConstructDomain(DomainStart=multiplication_3, DomainEnd=number_slider)
range = Range(Domain=dom, Steps="4")
range_2 = Range(Domain=dom_2, Steps="3")
division = Division(A=range_2, B="3.14")
concat = Concatenate(FragmentA="{", FragmentB=graft(range), FragmentC=",", FragmentD=division, FragmentE=",", FragmentF="0", FragmentG="}")

dom_3 = ConstructDomain(DomainStart=multiplication_5, DomainEnd=multiplication_6)
dom_4 = ConstructDomain(DomainStart=multiplication_7, DomainEnd=number_slider_4)
range_3 = Range(Domain=dom_3, Steps="4")
range_4 = Range(Domain=dom_4, Steps="3")
division_2 = Division(A=range_4, B="3.14")
concat_2 = Concatenate(
    FragmentA="{",
    FragmentB=graft(range_3),
    FragmentC=",",
    FragmentD=division_2,
    FragmentE=",",
    FragmentF="0",
    FragmentG="}")

pt = Point(<point referenced from the Rhino model>)
pl = ConstructPlane(Origin=pt, XAxis=Vector(1, 0, 0), YAxis=expr("-x", Vector(0, 1, 0)))
preview = CustomPreview(Geometry=pl, Shader=ColourSwatch(SwatchColor=RGB(255, 181, 181)))
sph = Sphere(Base=pl, Radius=Slider(0.68, range=0..1))

pt_2 = Point(<point referenced from the Rhino model>)
pl_2 = ConstructPlane(Origin=pt_2, XAxis=Vector(1, 0, 0), YAxis=expr("-x", Vector(0, 1, 0)))
preview_2 = CustomPreview(Geometry=pl_2, Shader=ColourSwatch(SwatchColor=RGB(255, 181, 181)))
sph_2 = Sphere(Base=pl_2, Radius=Slider(0.68, range=0..1))

# ----
# reverse every odd branch
python = GhPythonScript(x=concat)  # -> simplify(a); inputs x: tree
# ---------- python: Python ----------
import ghpythonlib.treehelpers as th

x = th.tree_to_list(x)[0]

print x

a = []

for i,l in enumerate(x):
    print l
    
    if i % 2 == 1:
        l.reverse()
     
    a.append(l)
     
print a

a = th.list_to_tree(a)

print a
# ---------- end python ----------

panel = Panel(concat)
panel_2 = Panel(python)

# ----
# reverse every odd branch
python_2 = GhPythonScript(x=concat_2)  # -> simplify(a); inputs x: tree; same code as python

panel_3 = Panel(concat_2)
panel_4 = Panel(python_2)

evalsrf = EvaluateSurface(Surface=sph, Point=python)  # -> Point, Normal, UDirection, VDirection, Frame
pln = Plane(flatten(evalsrf.Frame))
pflip = FlipPlane(Plane=pln, ReverseX=False, ReverseY=False, SwapAxes=True)
deplane = DeconstructPlane(Plane=pflip)  # -> Origin, XAxis, YAxis, ZAxis
rot3d = Rotate3D(Geometry=pflip, Angle="-pi/2", Center=deplane.Origin, Axis=deplane.ZAxis)  # -> Geometry, Transform

evalsrf_2 = EvaluateSurface(Surface=sph_2, Point=python_2)  # -> Point, Normal, UDirection, VDirection, Frame
pln_2 = Plane(flatten(evalsrf_2.Frame))
pflip_2 = FlipPlane(Plane=pln_2, ReverseX=False, ReverseY=False, SwapAxes=True)
deplane_2 = DeconstructPlane(Plane=pflip_2)  # -> Origin, XAxis, YAxis, ZAxis
# 1. SAVE THE GENERATED PLANES AS FRAMES WITH CENTER AND NORMAL VECTOR...NEED TO NOW TURN THESE INTO ROBOT CONFIGS EXPRESSED AS JOINT VALUES AS THE OTHERS ARE.
rot3d_2 = Rotate3D(Geometry=pflip_2, Angle="-pi/2", Center=deplane_2.Origin, Axis=deplane_2.ZAxis)  # -> Geometry, Transform

panel_5 = Panel("C:/Users/Edvard/Documents/GitHub/zerowaste_robot/configs/calibration/R2/")
save_data = Button()
pln_3 = Plane(rot3d.Geometry)
python_3 = GhPythonScript(planes=pln_3)  # -> frames; inputs planes: list
# ---------- python_3: Python ----------
from compas.geometry import Frame
from compas_ghpython import draw_frame
from compas_rhino.geometry import RhinoPlane
#
frames = []
for p in planes:
    f = RhinoPlane.from_geometry(p).to_compas()
#    f_trans = f.transformed(t_a.inverse())
    frames.append(f)
# ---------- end python_3 ----------
python_4 = GhPythonScript(frames=python_3, path=panel_5, save_data=save_data)  # inputs frames: list
# ---------- python_4: Python ----------
import os
from compas_fab.utilities import write_data_to_json

if save_data:
    for i,f in enumerate(frames):
        file_path = os.path.join(path, 'frame_{}.json'.format(i))
        f.to_json(file_path,pretty=True)
# ---------- end python_4 ----------
item = ListItem(List=rot3d.Geometry, Index=Slider(0, range=0..20), Wrap=True)
preview_3 = CustomPreview(Geometry=item, Shader=ColourSwatch(SwatchColor=RGB(73, 56, 255)))

panel_6 = Panel("C:/Users/Edvard/Documents/GitHub/zerowaste_robot/configs/calibration/R1/")
save_data_2 = Button()
pln_4 = Plane(rot3d_2.Geometry)
python_5 = GhPythonScript(planes=pln_4)  # -> frames; inputs planes: list; same code as python_3
python_6 = GhPythonScript(frames=python_5, path=panel_6, save_data=save_data_2)  # inputs frames: list; same code as python_4
item_2 = ListItem(List=rot3d_2.Geometry, Index=Slider(0, range=0..20), Wrap=True)
preview_4 = CustomPreview(Geometry=item_2, Shader=ColourSwatch(SwatchColor=RGB(73, 56, 255)))

# ----
# ROBOT CONNECT
list = ValueList({"Robot 1": 1, "Robot 2": 2}, selected="Robot 1")

panel_7 = Panel("ros-79hh-s4fg.yaler.io")
ros = ROSConnect(connect=Toggle(True))  # -> ros_client, is_connected; inputs port: Int32, connect: Boolean
#   port ip: The ip address ROS. Defaults to 127.0.0.1.
#   port port: The port of ROS. Defaults to 9090.
#   port connect: If True, connects to ROS. If False, disconnects from ROS. Defaults to False.
#   port ros_client: The ROS client.
#   port is_connected: True if connection established.
# ---------- ros: Python ----------
"""
Connect or disconnect to ROS.

COMPAS FAB v0.19.1
"""
from ghpythonlib.componentbase import executingcomponent as component
from scriptcontext import sticky as st

from compas_fab.backends import RosClient
from compas_fab.ghpython.components import create_id


class ROSConnect(component):
    def RunScript(self, ip, port, connect):
        ros_client = None

        ip = ip or '127.0.0.1'
        port = port or 9090

        key = create_id(self, 'ros_client')
        ros_client = st.get(key, None)

        if ros_client:
            st[key].close()
        if connect:
            st[key] = RosClient(ip, port)
            st[key].run(5)

        ros_client = st.get(key, None)
        is_connected = ros_client.is_connected if ros_client else False
        return (ros_client, is_connected)
# ---------- end ros ----------
# 2. CONNECT TO ROBOTS. BUT THESE CODE BLOCKS SHOULD BE REPLACED BY THE MORE UPDATED CODE IN THE ECL GIRHUB REPO.
data = Data(ros.ros_client)
robot = ROSRobot(ros_client=data, load=Toggle(True))  # -> robot; inputs load: Boolean
#   port ros_client: The ROS client.
#   port load: If True, loads the robot from ROS. Defaults to False.
# ---------- robot: Python ----------
"""
Load robot directly from ROS.

COMPAS FAB v0.19.1
"""
from compas_ghpython.artists import RobotModelArtist
from ghpythonlib.componentbase import executingcomponent as component
from scriptcontext import sticky as st

from compas_fab.ghpython.components import create_id


class ROSRobot(component):
    def RunScript(self, ros_client, load):
        key = create_id(self, 'robot')

        if ros_client and ros_client.is_connected and load:
            # Load URDF from ROS
            st[key] = ros_client.load_robot(load_geometry=True, precision='12f')
            st[key].artist = RobotModelArtist(st[key].model)

        robot = st.get(key, None)
        if robot:  # client sometimes need to be restarted, without needing to reload geometry
            robot.client = ros_client
        return robot
# ---------- end robot ----------
data_2 = Data(robot)

# ----
# If axis is included then allow the robot to move along track
list_2 = ValueList({"Robot 1": "robot1", "Robot 2": "robot2", "Robot 1 axis": "robot1_axis", "Robot 2 axis": "robot2_axis", "Robot 1 axis gripper": "robot1_axis_gripper", "Robot 2 axis gripper": "robot2_axis_gripper"}, selected="Robot 1 axis gripper")
list_3 = ValueList({"Robot 1": "robot1", "Robot 2": "robot2", "Robot 1 axis": "robot1_axis", "Robot 2 axis": "robot2_axis", "Robot 1 axis gripper": "robot1_axis_gripper", "Robot 2 axis gripper": "robot2_axis_gripper"}, selected="Robot 2 axis gripper")
rob_num = Number(list)
list_4 = ValueList({"platform": "ecl_platform", "world": "ecl_zero", "wobj_1": "rob1_acadia_EBIT_01", "wobj_2": "rob2_acadia_EBIT_01"}, selected="wobj_2")
list_5 = ValueList({"platform": "ecl_platform", "world": "ecl_zero", "wobj_1": "rob1_acadia_EBIT_01", "wobj_2": "rob2_acadia_EBIT_01"}, selected="wobj_1")
data_3 = Data(list_2)
data_4 = Data(list_3)
panel_8 = Panel(rob_num)
panel_9 = Panel(rob_num)
filter = StreamFilter(Gate=panel_8, Stream1=data_3, Stream2=data_4)
filter_2 = StreamFilter(Gate=panel_9, Stream1=list_5, Stream2=list_4)
data_5 = Data(filter_2)
data_6 = Data(filter)

panel_10 = Panel(rob_num)
pln_5 = Plane(rot3d_2.Geometry)
pln_6 = Plane(rot3d.Geometry)
filter_3 = StreamFilter(Gate=panel_10, Stream1=pln_5, Stream2=pln_6)
pln_7 = Plane(filter_3)
item_3 = ListItem(List=pln_7, Index=Slider(8, range=0..20), Wrap=True)  # -> Item, Item1
preview_5 = CustomPreview(Geometry=item_3.Item, Shader=ColourSwatch(SwatchColor=RGB(156, 255, 56)))

panel_11 = Panel(panel_6)
panel_12 = Panel(panel_5)
data_7 = Data(panel_12)
data_8 = Data(panel_11)
filter_4 = StreamFilter(Gate=panel_8, Stream1=data_8, Stream2=data_7)
data_9 = Data(filter_4)

# ----
# Robot 1
j6 = Slider(0, range=-400..400)
j1 = Slider(0, range=-180..180)
j2 = Slider(0, range=-90..150)
j3 = Slider(0, range=-180..75)
j4 = Slider(0, range=-400..400)
j5 = Slider(0, range=-125..120)
# FK - Preset Configs
track = Slider(0, range=0..4)
data_10 = Data([j1, track, j2, j6, j3, j5, j4])

# ----
# Robot 2
j6_2 = Slider(0, range=-400..400)
j1_2 = Slider(0, range=-180..180)
j2_2 = Slider(0, range=-90..150)
j3_2 = Slider(0, range=-180..75)
j4_2 = Slider(0, range=-400..400)
j5_2 = Slider(0, range=-125..120)
track_2 = Slider(4, range=0..4)
data_11 = Data([j1_2, track_2, j2_2, j6_2, j3_2, j5_2, j4_2])

# ----
# Planning Preset
python_7 = GhPythonScript()  # -> out, config
# ---------- python_7: Python ----------
#ROBOT 1 CONFIG
#Start path planning from

#axis 1-6 + track (mm)
config = [
-37.57,
-3.24,
8.36,
0.19,
84.45,
230,
100]

#config = [
#-37.57,
#-3.24,
#8.36,
#0.19,
#84.45,
#230,
#100]
# ---------- end python_7 ----------
python_8 = GhPythonScript()  # -> out, config
# ---------- python_8: Python ----------
#ROBOT 1 CONFIG
#Start path planning from

#axis 1-6 + track
config = [
0,
16.21,
-13.89,
-0.0,
87.68,
130.55,
0]

#axis 1-6 + track
#config = [40.55,16.21,-13.89,-0.0,87.68,130.55,3900]
# ---------- end python_8 ----------
config = GhPythonScript(robot=data_2, r1=python_7.config, r2=python_8.config)  # -> config, config_scaled; inputs r1: list, r2: list
# ---------- config: Python ----------
import math

config = robot.zero_configuration()

for i in range(6):
    config['r1_joint_{}'.format(i + 1)] = r1[i]
    config['r2_joint_{}'.format(i + 1)] = r2[i]

#mm
config['r1_cart_joint'] = r1[6]
config['r2_cart_joint'] = r2[6]

print config

#for use in path planning
#radians and meters
config_scaled = robot.zero_configuration()

for i in range(6):
    config_scaled['r1_joint_{}'.format(i + 1)] = math.radians(r1[i])
    config_scaled['r2_joint_{}'.format(i + 1)] = math.radians(r2[i])

#mm --> m
config_scaled['r1_cart_joint'] = r1[6]/1000
config_scaled['r2_cart_joint'] = r2[6]/1000

print config_scaled
# ---------- end config ----------

# ----
# Return Preset
python_9 = GhPythonScript()  # -> out, config
# ---------- python_9: Python ----------
#RETURN CONFIG (BEFORE PICKUP)

#axis 1-6 + track (mm)
config = [
-90.0,
0.0,
0.0,
0.0,
90,
180,
100]
# ---------- end python_9 ----------
python_10 = GhPythonScript()  # -> out, config
# ---------- python_10: Python ----------
#RETURN CONFIG (BEFORE PICKUP)

#axis 1-6 + track
config = [
0,
0.0,
0.0,
0.0,
0,
-90,
300]
# ---------- end python_10 ----------
config_2 = GhPythonScript(robot=data_2, r1=python_9.config, r2=python_10.config)  # -> config, config_scaled; inputs r1: list, r2: list; same code as config

# ----
# if you wana use FK to send to robot, scale to 'mm'
# FK
config_3 = GhPythonScript(robot=data_2, r1=data_10, r2=data_11)  # -> config; inputs r1: list, r2: list
# ---------- config_3: Python ----------
import math

config = robot.zero_configuration()

for i in range(6):
    config['r1_joint_{}'.format(i + 1)] = math.radians(r1[i])
    config['r2_joint_{}'.format(i + 1)] = math.radians(r2[i])

config['r1_cart_joint'] = r1[6]
config['r2_cart_joint'] = r2[6]

print config
# ---------- end config_3 ----------
gripper_frames = GhPythonScript(robot=data_2, config=config_3)  # -> out
# ---------- gripper_frames: Python ----------
print repr(robot.forward_kinematics(config, group='robot1_axis_gripper'))
print repr(robot.forward_kinematics(config, group='robot2_axis_gripper'))
# ---------- end gripper_frames ----------
panel_13 = Panel(gripper_frames)

list_6 = ValueList({"Forward Kinematics": 0, "Inverse Kinematics": 1, "Preset Start Planning Config": 2, "Preset Return Config": 3}, selected="Preset Start Planning Config")
filter_5 = StreamFilter(Gate=list_6, Stream0=config_3, Stream2=config.config_scaled, Stream3=config_2.config_scaled)
robot_visualize = RobotVisualize(robot=data_2, configuration=filter_5)  # -> visual, collision, attached_meshes, frames, base_frame, ee_frame; inputs attached_collision_meshes: list, show_visual: Boolean, show_collision: Boolean, show_frames: Boolean, show_base_frame: Boolean, show_end_effector_frame: Boolean, show_acm: Boolean
#   port group: The planning group used for end-effector and base visualization.
#   port configuration: The robot's full configuration.
#   port attached_collision_meshes: A list of attached collision meshes.
#   port show_visual: Whether or not to show the robot's visual meshes.
#   port show_collision: Whether or not to show the robot's collision meshes.
#   port show_frames: Whether or not to show the robot's joint frames.
#   port show_base_frame: Whether or not to show the robot's base frame.
#   port show_end_effector_frame: Whether or not to show the robot's end-effector frame.
#   port show_acm: Whether or not to show the attached collision meshes (if any).
#   port visual: The robot's visual Rhino meshes (if any).
#   port collision: The robot's collision Rhino meshes (if any).
#   port attached_meshes: The attached collision Rhino meshes (if any).
#   port frames: The robot's joint frames as Rhino planes (if any).
#   port base_frame: The robot's base frame as a Rhino plane (if any).
#   port ee_frame: The robot's end-effector frame as a Rhino plane (if any).
# ---------- robot_visualize: Python ----------
"""
Visualizes the robot.

COMPAS FAB v0.19.1
"""
from compas.geometry import Frame
from compas.geometry import Transformation
from compas_ghpython.artists import FrameArtist
from compas_ghpython.artists import MeshArtist
from ghpythonlib.componentbase import executingcomponent as component


class RobotVisualize(component):
    def RunScript(self, robot, group, configuration, attached_collision_meshes, show_visual, show_collision,
                  show_frames, show_base_frame, show_end_effector_frame, show_acm):

        visual = None
        collision = None
        attached_meshes = None
        frames = None
        base_frame = None
        ee_frame = None

        if robot:
            show_visual = True if show_visual is None else show_visual
            configuration = configuration or robot.zero_configuration()

            robot.update(configuration, visual=show_visual, collision=show_collision)
            compas_frames = robot.transformed_frames(configuration, group)

            if show_visual:
                visual = robot.artist.draw_visual()

            if show_collision:
                collision = robot.artist.draw_collision()

            if show_base_frame:
                base_compas_frame = compas_frames[0]
                artist = FrameArtist(base_compas_frame)
                base_frame = artist.draw()

            if show_end_effector_frame:
                ee_compas_frame = robot.forward_kinematics(configuration, group, options=dict(solver='model'))
                artist = FrameArtist(ee_compas_frame)
                ee_frame = artist.draw()

            if show_frames:
                frames = []
                for compas_frame in compas_frames[1:]:
                    artist = FrameArtist(compas_frame)
                    frame = artist.draw()
                    frames.append(frame)

            if show_acm:
                attached_meshes = []
                for acm in attached_collision_meshes:
                    frame = robot.forward_kinematics(configuration, options=dict(solver='model', link_name=acm.link_name))
                    T = Transformation.from_frame_to_frame(Frame.worldXY(), frame)
                    mesh = acm.collision_mesh.mesh.transformed(T)
                    attached_meshes.append(MeshArtist(mesh).draw())

        return (visual, collision, attached_meshes, frames, base_frame, ee_frame)
# ---------- end robot_visualize ----------

# ----
# WHAT SEEMS TO BE MISSING IS TURNING THE CURRENT GENERATED FRAMES (CENTER, NORMAL) INTO A JOINT CONFIG. MAYBE THE ROBOT IS MOVED TO THE GIVEN FRAME AND THEN THE CURRENT CONFIG IS READ IN HERE? BUT A MOVE BASED ON A FRAME SEEMS TO BE MISSING
# 3. SAVE THE CONFIG FOR THE CURRENT LOCATION OF THE ROBOT AS JOINT VALUES
# GET & SAVE CURRENT CONFIG
data_12 = Data(data)
panel_14 = Panel(rob_num)
data_13 = Data(data_2)
python_11 = GhPythonScript(ros=data_12, rob_num=panel_14, robot=data_13, get_info=Toggle(False))  # -> out, config; inputs rob_num: Int32
# ---------- python_11: Python ----------
import compas_rrc as rrc
from compas.geometry import Frame
from compas.geometry import Plane

#from compas.robots import Robot
from compas_fab.robots import Configuration

from compas_rhino.geometry import RhinoPlane


config = robot.zero_configuration()
if get_info:
    
    if rob_num == 1:
        abb = rrc.AbbClient(ros, '/rob1')
        
        current_joints, current_track = abb.send_and_wait(rrc.GetJoints(),  timeout = 3)
        
        config['r1_cart_joint'] = current_track[0]
        config['r1_joint_1'] = current_joints[0]
        config['r1_joint_2'] = current_joints[1]
        config['r1_joint_3'] = current_joints[2]
        config['r1_joint_4'] = current_joints[3]
        config['r1_joint_5'] = current_joints[4]
        config['r1_joint_6'] = current_joints[5]

    elif rob_num == 2:
        abb = rrc.AbbClient(ros, '/rob2')
        
        current_joints, current_track = abb.send_and_wait(rrc.GetJoints(),  timeout = 3)
        
        config['r2_cart_joint'] = current_track[0]
        config['r2_joint_1'] = current_joints[0]
        config['r2_joint_2'] = current_joints[1]
        config['r2_joint_3'] = current_joints[2]
        config['r2_joint_4'] = current_joints[3]
        config['r2_joint_5'] = current_joints[4]
        config['r2_joint_6'] = current_joints[5]
    
print config
# ---------- end python_11 ----------
panel_15 = Panel(python_11.out)

# ----
# READ-IN  CONFIG
panel_16 = Panel(rob_num)
data_14 = Data(data_9)
python_12 = GhPythonScript(rob_num=panel_16, path=data_14, member_num=Slider(8, range=1..30), read_data=Toggle(True))  # -> configs; inputs member_num: Int32
# ---------- python_12: Python ----------
import os
from compas_fab.utilities import read_data_from_json
from compas_fab.robots import Configuration

configs = []
print  path

if read_data:
    data = read_data_from_json(os.path.join(path, 'calibration_config_{0:0{width}}.json'.format(member_num, width=3)))
    config = Configuration.from_data(data)
    
    print data
    print configs
    
    configs.append(config)

print configs
# ---------- end python_12 ----------
# 4. READ IN A CONFIG TO THEN SEND TO THE ROBOTS
panel_17 = Panel(python_12)

save_data_3 = Button()
data_15 = Data(python_11.config)
panel_18 = Panel(rob_num)
data_16 = Data(data_9)
python_13 = GhPythonScript(rob_num=panel_18, config=data_15, path=data_16, member_num=Slider(8, range=1..30), save_data=save_data_3)  # inputs member_num: Int32
# ---------- python_13: Python ----------
import os
import json

print path
c = config.to_data()

if save_data:
    with open(os.path.join(path, 'calibration_config_{0:0{width}}.json'.format(member_num, width=3)), 'w') as f:
        json.dump(c, f, indent=4)
# ---------- end python_13 ----------

# ---- group: 1. return configuration
button = Button()
data_17 = Data(config_2.config)

# ---- group: 2. calibration configurations
button_2 = Button()
data_18 = Data(python_12)

# ---- group: choose robot to send to
data_19 = Data(data)
panel_19 = Panel(rob_num)
panel_20 = Panel(data_5)

# ----
# SEND ROBOT COMMANDS
toggle = BooleanToggle(False)
python_14 = GhPythonScript(
    ros=data_19,
    rob_num=panel_19,
    wobj=panel_20,
    return_config=data_17,
    send_return=button,
    calibration_configs=data_18,
    send_calibration_pos=button_2,
    get_info=toggle)  # -> out, current_joints; inputs rob_num: Int32, calibration_configs: list
# ---------- python_14: Python ----------
import compas_rrc as rrc
from compas.geometry import Frame
from compas.geometry import Plane

from compas_rhino.geometry import RhinoPlane

# Create ABB Client (rob2 = right, rob1 = left)
if rob_num == 1:
    abb = rrc.AbbClient(ros, '/rob1')
    abb.send(rrc.SetTool('ecl_pneumatic_gripper'))
    DO = 'do_1'
    print('Connected.')
elif rob_num == 2:
    abb = rrc.AbbClient(ros, '/rob2')
    abb.send(rrc.SetTool('ecl_pneumatic_gripper'))
    DO = 'do_2'
    print('Connected.')

# Define speeds
speed = 100

# set wobj
abb.send(rrc.SetWorkObject(wobj))

if get_info:
    current_joints = abb.send_and_wait(rrc.GetJoints(),  timeout = 3)
    print current_joints
    

if send_return:
    
    if rob_num == 1:
        axis = rrc.ExternalAxes(return_config['r1_cart_joint'])
        joints = rrc.RobotJoints(
            return_config['r1_joint_1'],
            return_config['r1_joint_2'],
            return_config['r1_joint_3'],
            return_config['r1_joint_4'],
            return_config['r1_joint_5'],
            return_config['r1_joint_6'],
        )
    elif rob_num == 2:
        axis = rrc.ExternalAxes(return_config['r2_cart_joint'])
        joints = rrc.RobotJoints(
            return_config['r2_joint_1'],
            return_config['r2_joint_2'],
            return_config['r2_joint_3'],
            return_config['r2_joint_4'],
            return_config['r2_joint_5'],
            return_config['r2_joint_6'],
        )
        
    done = abb.send(rrc.MoveToJoints(joints, axis, speed, rrc.Zone.FINE))
    print('Finished')

    
if send_calibration_pos:
    
    print calibration_configs
    
    for config in calibration_configs:
        if rob_num == 1:
            axis = rrc.ExternalAxes(config['r1_cart_joint'])
            joints = rrc.RobotJoints(
                config['r1_joint_1'],
                config['r1_joint_2'],
                config['r1_joint_3'],
                config['r1_joint_4'],
                config['r1_joint_5'],
                config['r1_joint_6'],
            )
        elif rob_num == 2:
            axis = rrc.ExternalAxes(config['r2_cart_joint'])
            joints = rrc.RobotJoints(
                config['r2_joint_1'],
                config['r2_joint_2'],
                config['r2_joint_3'],
                config['r2_joint_4'],
                config['r2_joint_5'],
                config['r2_joint_6'],
            )
        done = abb.send(rrc.MoveToJoints(joints, axis, speed, rrc.Zone.FINE))
        print('Finished')
# ---------- end python_14 ----------
panel_21 = Panel(python_14.out)
panel_22 = Panel(python_14.current_joints)
