# Grasshopper definition ECL_generate_calibration_frames.gh (Grasshopper 1.0.7)

number_slider = Slider(-1.3, range=-1.5..1)
multiplication = Multiplication(A=Slider(-0.8, range=-1..1), B="pi")
multiplication_2 = Multiplication(A=Slider(-0.1, range=-1..1), B="pi")
multiplication_3 = Multiplication(A=Slider(-1.3, range=-1.5..1), B="pi")
multiplication_4 = Multiplication(A=number_slider, B="pi")

dom = ConstructDomain(DomainStart=multiplication, DomainEnd=multiplication_2)
dom_2 = ConstructDomain(DomainStart=multiplication_3, DomainEnd=number_slider)
range = Range(Domain=dom, Steps="4")
range_2 = Range(Domain=dom_2, Steps="3")
division = Division(A=range_2, B="3.14")
concat = Concatenate(FragmentA="{", FragmentB=graft(range), FragmentC=",", FragmentD=division, FragmentE=",", FragmentF="0", FragmentG="}")

pt = Point(<point referenced from the Rhino model>)
pl = ConstructPlane(Origin=pt, XAxis=Vector(1, 0, 0), YAxis=expr("-x", Vector(0, 1, 0)))
preview = CustomPreview(Geometry=pl, Shader=ColourSwatch(SwatchColor=RGB(255, 181, 181)))
sph = Sphere(Base=pl, Radius=Slider(0.68, range=0..1))

# ----
# reverse every odd branch
python = GhPythonScript(x=concat)  # -> simplify(a); inputs x: tree
# ---------- python: Python ----------
import ghpythonlib.treehelpers as th

x = th.tree_to_list(x)[0]

print x

a = []

for i,l in enumerate(x):
    print l
    
    if i % 2 == 1:
        l.reverse()
     
    a.append(l)
     
print a

a = th.list_to_tree(a)

print a
# ---------- end python ----------

panel = Panel(concat)
panel_2 = Panel(python)

evalsrf = EvaluateSurface(Surface=sph, Point=python)  # -> Point, Normal, UDirection, VDirection, Frame
pln = Plane(flatten(evalsrf.Frame))
pflip = FlipPlane(Plane=pln, ReverseX=False, ReverseY=False, SwapAxes=True)
deplane = DeconstructPlane(Plane=pflip)  # -> Origin, XAxis, YAxis, ZAxis
rot3d = Rotate3D(Geometry=pflip, Angle="-pi/2", Center=deplane.Origin, Axis=deplane.ZAxis)  # -> Geometry, Transform

panel_3 = Panel("C:\Users\Edvard\Documents\GitHub\zerowaste_robot\calibration_frames")
save_data = Button()
pln_2 = Plane(rot3d.Geometry)
python_2 = GhPythonScript(planes=pln_2)  # -> frames; inputs planes: list
# ---------- python_2: Python ----------
from compas.geometry import Frame
from compas_ghpython import draw_frame
from compas_rhino.geometry import RhinoPlane
#
frames = []
for p in planes:
    f = RhinoPlane.from_geometry(p).to_compas()
#    f_trans = f.transformed(t_a.inverse())
    frames.append(f)
# ---------- end python_2 ----------
python_3 = GhPythonScript(frames=python_2, path=panel_3, save_data=save_data)  # inputs frames: list
# ---------- python_3: Python ----------
import os
from compas_fab.utilities import write_data_to_json

if save_data:
    for i,f in enumerate(frames):
        file_path = os.path.join(path, 'frame_{}.json'.format(i))
        f.to_json(file_path,pretty=True)
# ---------- end python_3 ----------
item = ListItem(List=rot3d.Geometry, Index=Slider(0, range=0..20), Wrap=True)

preview_2 = CustomPreview(Geometry=item, Shader=ColourSwatch(SwatchColor=RGB(73, 56, 255)))
