# Grasshopper definition _generate_calibration_frames.gh (Grasshopper 1.0.7)

number_slider = Slider(-1.3, range=-1.5..1)
multiplication = Multiplication(A=Slider(-0.8, range=-1..1), B="pi")
multiplication_2 = Multiplication(A=Slider(-0.1, range=-1..1), B="pi")
multiplication_3 = Multiplication(A=Slider(-1.3, range=-1.5..1), B="pi")
multiplication_4 = Multiplication(A=number_slider, B="pi")

number_slider_2 = Slider(-1.3, range=-1.5..1)
multiplication_5 = Multiplication(A=Slider(0.2, range=-1..1), B="pi")
multiplication_6 = Multiplication(A=Slider(0.8, range=-1..1), B="pi")
multiplication_7 = Multiplication(A=Slider(-1.3, range=-1.5..1), B="pi")
multiplication_8 = Multiplication(A=number_slider_2, B="pi")

dom = ConstructDomain(DomainStart=multiplication, DomainEnd=multiplication_2)
dom_2 = ConstructDomain(DomainStart=multiplication_3, DomainEnd=number_slider)
range = Range(Domain=dom, Steps="4")
range_2 = Range(Domain=dom_2, Steps="3")
division = Division(A=range_2, B="3.14")
concat = Concatenate(FragmentA="{", FragmentB=graft(range), FragmentC=",", FragmentD=division, FragmentE=",", FragmentF="0", FragmentG="}")

pt = Point(<point referenced from the Rhino model>)
pl = ConstructPlane(Origin=pt, XAxis=Vector(1, 0, 0), YAxis=expr("-x", Vector(0, 1, 0)))
preview = CustomPreview(Geometry=pl, Shader=ColourSwatch(SwatchColor=RGB(255, 181, 181)))
sph = Sphere(Base=pl, Radius=Slider(0.68, range=0..1))

dom_3 = ConstructDomain(DomainStart=multiplication_5, DomainEnd=multiplication_6)
dom_4 = ConstructDomain(DomainStart=multiplication_7, DomainEnd=number_slider_2)
range_3 = Range(Domain=dom_3, Steps="4")
range_4 = Range(Domain=dom_4, Steps="3")
division_2 = Division(A=range_4, B="3.14")
concat_2 = Concatenate(
    FragmentA="{",
    FragmentB=graft(range_3),
    FragmentC=",",
    FragmentD=division_2,
    FragmentE=",",
    FragmentF="0",
    FragmentG="}")

pt_2 = Point(<point referenced from the Rhino model>)
pl_2 = ConstructPlane(Origin=pt_2, XAxis=Vector(1, 0, 0), YAxis=expr("-x", Vector(0, 1, 0)))
preview_2 = CustomPreview(Geometry=pl_2, Shader=ColourSwatch(SwatchColor=RGB(255, 181, 181)))
sph_2 = Sphere(Base=pl_2, Radius=Slider(0.68, range=0..1))

# ----
# reverse every odd branch
python = GhPythonScript(x=concat)  # -> simplify(a); inputs x: tree
# ---------- python: Python ----------
import ghpythonlib.treehelpers as th

x = th.tree_to_list(x)[0]

print x

a = []

for i,l in enumerate(x):
    print l
    
    if i % 2 == 1:
        l.reverse()
     
    a.append(l)
     
print a

a = th.list_to_tree(a)

print a
# ---------- end python ----------

panel = Panel(concat)
panel_2 = Panel(python)

# ----
# reverse every odd branch
python_2 = GhPythonScript(x=concat_2)  # -> simplify(a); inputs x: tree; same code as python

panel_3 = Panel(concat_2)
panel_4 = Panel(python_2)

evalsrf = EvaluateSurface(Surface=sph, Point=python)  # -> Point, Normal, UDirection, VDirection, Frame
pln = Plane(flatten(evalsrf.Frame))
pflip = FlipPlane(Plane=pln, ReverseX=False, ReverseY=False, SwapAxes=True)
deplane = DeconstructPlane(Plane=pflip)  # -> Origin, XAxis, YAxis, ZAxis
rot3d = Rotate3D(Geometry=pflip, Angle="-pi/2", Center=deplane.Origin, Axis=deplane.ZAxis)  # -> Geometry, Transform

evalsrf_2 = EvaluateSurface(Surface=sph_2, Point=python_2)  # -> Point, Normal, UDirection, VDirection, Frame
pln_2 = Plane(flatten(evalsrf_2.Frame))
pflip_2 = FlipPlane(Plane=pln_2, ReverseX=False, ReverseY=False, SwapAxes=True)
deplane_2 = DeconstructPlane(Plane=pflip_2)  # -> Origin, XAxis, YAxis, ZAxis
rot3d_2 = Rotate3D(Geometry=pflip_2, Angle="-pi/2", Center=deplane_2.Origin, Axis=deplane_2.ZAxis)  # -> Geometry, Transform

panel_5 = Panel("C:\Users\Edvard\Documents\GitHub\zerowaste_robot\calibration_frames")
save_data = Button()
pln_3 = Plane(rot3d.Geometry)
python_3 = GhPythonScript(planes=pln_3)  # -> frames; inputs planes: list
# ---------- python_3: Python ----------
from compas.geometry import Frame
from compas_ghpython import draw_frame
from compas_rhino.geometry import RhinoPlane
#
frames = []
for p in planes:
    f = RhinoPlane.from_geometry(p).to_compas()
#    f_trans = f.transformed(t_a.inverse())
    frames.append(f)
# ---------- end python_3 ----------
python_4 = GhPythonScript(frames=python_3, path=panel_5, save_data=save_data)  # inputs frames: list
# ---------- python_4: Python ----------
import os
from compas_fab.utilities import write_data_to_json

if save_data:
    for i,f in enumerate(frames):
        file_path = os.path.join(path, 'frame_{}.json'.format(i))
        f.to_json(file_path,pretty=True)
# ---------- end python_4 ----------
item = ListItem(List=rot3d.Geometry, Index=Slider(0, range=0..20), Wrap=True)

panel_6 = Panel("C:\Users\Edvard\Documents\GitHub\zerowaste_robot\calibration_frames")
save_data_2 = Button()
pln_4 = Plane(rot3d_2.Geometry)
python_5 = GhPythonScript(planes=pln_4)  # -> frames; inputs planes: list; same code as python_3
python_6 = GhPythonScript(frames=python_5, path=panel_6, save_data=save_data_2)  # inputs frames: list; same code as python_4
item_2 = ListItem(List=rot3d_2.Geometry, Index=Slider(0, range=0..20), Wrap=True)

# ----
# R1
swatch = ColourSwatch(SwatchColor=RGB(73, 56, 255))
preview_3 = CustomPreview(Geometry=item, Shader=swatch)

# ----
# R2
swatch_2 = ColourSwatch(SwatchColor=RGB(73, 56, 255))
preview_4 = CustomPreview(Geometry=item_2, Shader=swatch_2)

# ----
# ROBOT CONNECT
list = ValueList({"Robot 1": 1, "Robot 2": 2}, selected="Robot 2")

panel_7 = Panel("ros-79hh-s4fg.yaler.io")
ros = ROSConnect(connect=Toggle(True))  # -> ros_client, is_connected; inputs port: Int32, connect: Boolean
#   port ip: The ip address ROS. Defaults to 127.0.0.1.
#   port port: The port of ROS. Defaults to 9090.
#   port connect: If True, connects to ROS. If False, disconnects from ROS. Defaults to False.
#   port ros_client: The ROS client.
#   port is_connected: True if connection established.
# ---------- ros: Python ----------
"""
Connect or disconnect to ROS.

COMPAS FAB v0.19.1
"""
from ghpythonlib.componentbase import executingcomponent as component
from scriptcontext import sticky as st

from compas_fab.backends import RosClient
from compas_fab.ghpython.components import create_id


class ROSConnect(component):
    def RunScript(self, ip, port, connect):
        ros_client = None

        ip = ip or '127.0.0.1'
        port = port or 9090

        key = create_id(self, 'ros_client')
        ros_client = st.get(key, None)

        if ros_client:
            st[key].close()
        if connect:
            st[key] = RosClient(ip, port)
            st[key].run(5)

        ros_client = st.get(key, None)
        is_connected = ros_client.is_connected if ros_client else False
        return (ros_client, is_connected)
# ---------- end ros ----------
data = Data(ros.ros_client)
robot = ROSRobot(ros_client=data, load=Toggle(True))  # -> robot; inputs load: Boolean
#   port ros_client: The ROS client.
#   port load: If True, loads the robot from ROS. Defaults to False.
# ---------- robot: Python ----------
"""
Load robot directly from ROS.

COMPAS FAB v0.19.1
"""
from compas_ghpython.artists import RobotModelArtist
from ghpythonlib.componentbase import executingcomponent as component
from scriptcontext import sticky as st

from compas_fab.ghpython.components import create_id


class ROSRobot(component):
    def RunScript(self, ros_client, load):
        key = create_id(self, 'robot')

        if ros_client and ros_client.is_connected and load:
            # Load URDF from ROS
            st[key] = ros_client.load_robot(load_geometry=True, precision='12f')
            st[key].artist = RobotModelArtist(st[key].model)

        robot = st.get(key, None)
        if robot:  # client sometimes need to be restarted, without needing to reload geometry
            robot.client = ros_client
        return robot
# ---------- end robot ----------
data_2 = Data(robot)

python_7 = GhPythonScript(robot=data_2, reset=Button())  # -> out, a
# ---------- python_7: Python ----------
print robot.info()

print robot.get_configurable_joint_names()
print robot.zero_configuration()
# ---------- end python_7 ----------

# ----
# If axis is included then allow the robot to move along track
list_2 = ValueList({"Robot 1": "robot1", "Robot 2": "robot2", "Robot 1 axis": "robot1_axis", "Robot 2 axis": "robot2_axis", "Robot 1 axis gripper": "robot1_axis_gripper", "Robot 2 axis gripper": "robot2_axis_gripper"}, selected="Robot 1")
list_3 = ValueList({"Robot 1": "robot1", "Robot 2": "robot2", "Robot 1 axis": "robot1_axis", "Robot 2 axis": "robot2_axis", "Robot 1 axis gripper": "robot1_axis_gripper", "Robot 2 axis gripper": "robot2_axis_gripper"}, selected="Robot 2")
rob_num = Number(list)
list_4 = ValueList({"platform": "ecl_platform", "world": "ecl_zero", "wobj_1": "rob1_acadia_EBIT_01", "wobj_2": "rob2_acadia_EBIT_01"}, selected="wobj_2")
list_5 = ValueList({"platform": "ecl_platform", "world": "ecl_zero", "wobj_1": "rob1_acadia_EBIT_01", "wobj_2": "rob2_acadia_EBIT_01"}, selected="wobj_1")
data_3 = Data(list_2)
data_4 = Data(list_3)
panel_8 = Panel(rob_num)
panel_9 = Panel(rob_num)
filter = StreamFilter(Gate=panel_8, Stream1=data_3, Stream2=data_4)
filter_2 = StreamFilter(Gate=panel_9, Stream1=list_5, Stream2=list_4)
data_5 = Data(filter_2)
data_6 = Data(filter)

panel_10 = Panel(python_7.out)
pln_5 = Plane(rot3d.Geometry)
pln_6 = Plane(rot3d_2.Geometry)
filter_3 = StreamFilter(Gate=panel_8, Stream1=pln_5, Stream2=pln_6)
pln_7 = Plane(filter_3)
item_3 = ListItem(List=pln_7, Index=Slider(7, range=0..20), Wrap=True)  # -> Item, Item1
preview_5 = CustomPreview(Geometry=item_3.Item, Shader=ColourSwatch(SwatchColor=RGB(156, 255, 56)))

# ----
# Robot 1
j6 = Slider(0, range=-400..400)
j1 = Slider(0, range=-180..180)
j2 = Slider(0, range=-90..150)
j3 = Slider(0, range=-180..75)
j4 = Slider(0, range=-400..400)
j5 = Slider(0, range=-125..120)
# FK - Preset Configs
track = Slider(0, range=0..4)
data_7 = Data([j1, j2, j3, j4, j5, j6, track])

# ----
# ROBOT2
panel_11 = Panel("3246.00")
pt_3 = ConstructPoint(XCoordinate=panel_11, YCoordinate="1836.50", ZCoordinate="733.40")
Z = UnitZ(Factor="450.00")
division_3 = Division(A=pt_3, B=1000)
division_4 = Division(A=Z, B=1000)
pl_3 = ConstructPlane(Origin=division_3, XAxis=Vector(-1, 0, 0), YAxis=Vector(0, 1, 0))
pl_4 = ConstructPlane(Origin=pt_3, XAxis=Vector(-1, 0, 0), YAxis=Vector(0, 1, 0))
move = Move(Geometry=pl_3, Motion=division_4)  # -> Geometry, Transform
move_2 = Move(Geometry=pl_4, Motion=Z)  # -> Geometry, Transform
pln_8 = Plane(move.Geometry)
pln_9 = Plane(pl_3)
pln_10 = Plane(move_2.Geometry)
pln_11 = Plane(pl_4)

# ----
# Robot 2
j6_2 = Slider(0, range=-400..400)
j1_2 = Slider(0, range=-180..180)
j2_2 = Slider(0, range=-90..150)
j3_2 = Slider(0, range=-180..75)
j4_2 = Slider(0, range=-400..400)
j5_2 = Slider(0, range=-125..120)
track_2 = Slider(4, range=0..4)
data_8 = Data([j1_2, j2_2, j3_2, j4_2, j5_2, j6_2, track_2])

# ----
# Planning Preset
python_8 = GhPythonScript()  # -> out, config
# ---------- python_8: Python ----------
#ROBOT 1 CONFIG
#Start path planning from

#axis 1-6 + track (mm)
config = [
-37.57,
-3.24,
8.36,
0.19,
84.45,
230,
100]

#config = [
#-37.57,
#-3.24,
#8.36,
#0.19,
#84.45,
#230,
#100]
# ---------- end python_8 ----------
python_9 = GhPythonScript()  # -> out, config
# ---------- python_9: Python ----------
#ROBOT 1 CONFIG
#Start path planning from

#axis 1-6 + track
config = [
0,
16.21,
-13.89,
-0.0,
87.68,
130.55,
0]

#axis 1-6 + track
#config = [40.55,16.21,-13.89,-0.0,87.68,130.55,3900]
# ---------- end python_9 ----------
config = GhPythonScript(robot=data_2, r1=python_8.config, r2=python_9.config)  # -> config, config_scaled; inputs r1: list, r2: list
# ---------- config: Python ----------
import math

config = robot.zero_configuration()

for i in range(6):
    config['r1_joint_{}'.format(i + 1)] = r1[i]
    config['r2_joint_{}'.format(i + 1)] = r2[i]

#mm
config['r1_cart_joint'] = r1[6]
config['r2_cart_joint'] = r2[6]

print config

#for use in path planning
#radians and meters
config_scaled = robot.zero_configuration()

for i in range(6):
    config_scaled['r1_joint_{}'.format(i + 1)] = math.radians(r1[i])
    config_scaled['r2_joint_{}'.format(i + 1)] = math.radians(r2[i])

#mm --> m
config_scaled['r1_cart_joint'] = r1[6]/1000
config_scaled['r2_cart_joint'] = r2[6]/1000

print config_scaled
# ---------- end config ----------

# ----
# Return Preset
python_10 = GhPythonScript()  # -> out, config
# ---------- python_10: Python ----------
#RETURN CONFIG (BEFORE PICKUP)

#axis 1-6 + track (mm)
config = [
-90.0,
0.0,
0.0,
0.0,
90,
180,
100]
# ---------- end python_10 ----------
python_11 = GhPythonScript()  # -> out, config
# ---------- python_11: Python ----------
#RETURN CONFIG (BEFORE PICKUP)

#axis 1-6 + track
config = [
0,
0.0,
0.0,
0.0,
0,
-90,
0]
# ---------- end python_11 ----------
config_2 = GhPythonScript(robot=data_2, r1=python_10.config, r2=python_11.config)  # -> config, config_scaled; inputs r1: list, r2: list; same code as config

# ----
# FK
config_3 = GhPythonScript(robot=data_2, r1=data_7, r2=data_8)  # -> config; inputs r1: list, r2: list
# ---------- config_3: Python ----------
import math

config = robot.zero_configuration()

for i in range(6):
    config['r1_joint_{}'.format(i + 1)] = math.radians(r1[i])
    config['r2_joint_{}'.format(i + 1)] = math.radians(r2[i])

config['r1_cart_joint'] = r1[6]
config['r2_cart_joint'] = r2[6]

print config
# ---------- end config_3 ----------
gripper_frames = GhPythonScript(robot=data_2, config=config_3)  # -> out
# ---------- gripper_frames: Python ----------
print repr(robot.forward_kinematics(config, group='robot1_axis_gripper'))
print repr(robot.forward_kinematics(config, group='robot2_axis_gripper'))
# ---------- end gripper_frames ----------
panel_12 = Panel(gripper_frames)

panel_13 = Panel("APPROACH PLANE")
pln_12 = Plane(item_3.Item)
pln_13 = Plane(item_3.Item1)

constraints_from_plane = ConstraintsFromPlane(robot=data_2, plane=pln_13, group=data_6)  # -> constraints
#   port plane: The plane or frame from which we create position and orientation constraints.
#   port group: The planning group for which we specify the constraint. Defaults to the robot's main planning group.
#   port tolerance_position: The allowed tolerance to the frame's position (defined in the robot's units). Defaults to 0.001
#   port tolerance_xaxis: The allowed tolerance of the frame's X-axis in degrees.
#   port tolerance_yaxis: The allowed tolerance of the frame's Y-axis in degrees.
#   port tolerance_zaxis: The allowed tolerance of the frame's Z-axis in degrees.
#   port constraints: A list containing a position and an orientation constraint.
# ---------- constraints_from_plane: Python ----------
"""
Create a position and an orientation constraint from a plane calculated for the group's end-effector link.

COMPAS FAB v0.19.1
"""
import math

from ghpythonlib.componentbase import executingcomponent as component

from compas_fab.ghpython.components import coerce_frame


class ConstraintsFromPlane(component):
    def RunScript(self, robot, plane, group, tolerance_position, tolerance_xaxis, tolerance_yaxis, tolerance_zaxis):
        goal_constraints = None
        if robot and plane:
            tolerance_position = tolerance_position or 0.001
            tolerance_xaxis = tolerance_xaxis or 1.
            tolerance_yaxis = tolerance_yaxis or 1.
            tolerance_zaxis = tolerance_zaxis or 1.

            frame = coerce_frame(plane)
            tolerances_axes = [math.radians(tolerance_xaxis), math.radians(tolerance_yaxis), math.radians(tolerance_zaxis)]
            goal_constraints = robot.constraints_from_frame(frame, tolerance_position, tolerances_axes, group)

        return goal_constraints
# ---------- end constraints_from_plane ----------

# ---- group: 1. return configuration
data_9 = Data(config_2.config)
button = Button()

# ---- group: 2. pick member path
button_2 = Button()
data_10 = Data()
data_11 = Data()
data_12 = Data()

# ---- group: 4. path plan (end)
button_3 = Button()
data_13 = Data()
data_14 = Data()

# ---- group: choose robot to send to
# SEND ROBOT COMMANDS
data_15 = Data(data)
panel_14 = Panel(rob_num)
panel_15 = Panel(data_5)

# ----
# IK
panel_16 = Panel(rob_num)
pln_14 = Plane(pln_8)
use_fk_as_start = BooleanToggle(True)
filter_4 = StreamFilter(Gate=use_fk_as_start)

# ----
# ROBOT1
panel_17 = Panel("3246.00")
pt_4 = ConstructPoint(XCoordinate=panel_17, YCoordinate="1838.30", ZCoordinate="729.60")
Z_2 = UnitZ(Factor="450.00")
division_5 = Division(A=pt_4, B=1000)
division_6 = Division(A=Z_2, B=1000)
pl_5 = ConstructPlane(Origin=division_5, XAxis=Vector(-1, 0, 0), YAxis=Vector(0, 1, 0))
move_3 = Move(Geometry=pl_5, Motion=division_6)  # -> Geometry, Transform
pln_15 = Plane(move_3.Geometry)
pln_16 = Plane(pl_5)

pln_17 = Plane(pln_15)
filter_5 = StreamFilter(Gate=panel_16, Stream1=pln_17, Stream2=pln_14)
ik = InverseKinematics(robot=data_2, plane=filter_5, start_configuration=config_3, group=data_6)  # -> configuration
#   port plane: The plane or frame to calculate the inverse kinematic for.
#   port start_configuration: If passed, calculates the inverse such that the joint positions differ the least from the start_configuration. Defaults to the zero configuration.
#   port group: The planning group used for calculation. Defaults to the robot's main planning group.
#   port configuration: The planning group's configuration.
# ---------- ik: Python ----------
"""
Calculate the robot's inverse kinematic for a given plane.

COMPAS FAB v0.19.1
"""
from ghpythonlib.componentbase import executingcomponent as component

from compas_fab.ghpython.components import coerce_frame


class InverseKinematics(component):
    def RunScript(self, robot, plane, start_configuration, group):
        configuration = None
        if robot and robot.client and robot.client.is_connected and plane:
            frame = coerce_frame(plane)
            configuration = robot.inverse_kinematics(frame, start_configuration, group)
        if start_configuration:
            return start_configuration.merged(configuration)
        else:
            return configuration
# ---------- end ik ----------

# ----
# MEMBER PICKUP PLANES
pl_6 = ConstructPlane(Origin=pt_4, XAxis=Vector(-1, 0, 0), YAxis=Vector(0, 1, 0))

move_4 = Move(Geometry=pl_6, Motion=Z_2)  # -> Geometry, Transform
pln_18 = Plane(move_4.Geometry)
pln_19 = Plane(pl_6)

# ---- group: send pickup planes
python_12 = GhPythonScript()  # -> t_a
# ---------- python_12: Python ----------
from compas.geometry import Frame
from compas.geometry import Point
from compas_ghpython import draw_frame
from compas.geometry import Transformation

from compas_rhino.geometry import RhinoPlane

wobj_A = Frame.from_quaternion([0.999964,0.00426176,-0.00158504,-0.00717332])
wobj_A.point = [-681.039,1564.71,817.284]

f_a = RhinoPlane.from_geometry(wobj_A).to_compas() 
print(f_a)

t_a = Transformation.from_frame(f_a)
print t_a
# ---------- end python_12 ----------
merge = Merge(Data1=pln_18, Data2=pln_19)
merge_2 = Merge(Data1=pln_10, Data2=pln_11)
python_13 = GhPythonScript(p_send=merge, t_a=python_12)  # -> f_send; inputs p_send: list
# ---------- python_13: Python ----------
from compas.geometry import Frame
from compas_ghpython import draw_frame
from compas_rhino.geometry import RhinoPlane
#
f_send = []
for p in p_send:
    f = RhinoPlane.from_geometry(p).to_compas()
    f_trans = f.transformed(t_a.inverse())
    f_send.append(f_trans)
    
print f_send
# ---------- end python_13 ----------
python_14 = GhPythonScript(p_send=merge_2, t_a=python_12)  # -> f_send; inputs p_send: list; same code as python_13

# ----
list_6 = ValueList({"Forward Kinematics": 0, "Inverse Kinematics": 1, "Preset Start Planning Config": 2, "Preset Return Config": 3}, selected="Preset Return Config")
filter_6 = StreamFilter(Gate=list_6, Stream0=config_3, Stream1=ik, Stream2=config.config_scaled, Stream3=config_2.config_scaled)
robot_visualize = RobotVisualize(robot=data_2, configuration=filter_6)  # -> visual, collision, attached_meshes, frames, base_frame, ee_frame; inputs attached_collision_meshes: list, show_visual: Boolean, show_collision: Boolean, show_frames: Boolean, show_base_frame: Boolean, show_end_effector_frame: Boolean, show_acm: Boolean
#   port group: The planning group used for end-effector and base visualization.
#   port configuration: The robot's full configuration.
#   port attached_collision_meshes: A list of attached collision meshes.
#   port show_visual: Whether or not to show the robot's visual meshes.
#   port show_collision: Whether or not to show the robot's collision meshes.
#   port show_frames: Whether or not to show the robot's joint frames.
#   port show_base_frame: Whether or not to show the robot's base frame.
#   port show_end_effector_frame: Whether or not to show the robot's end-effector frame.
#   port show_acm: Whether or not to show the attached collision meshes (if any).
#   port visual: The robot's visual Rhino meshes (if any).
#   port collision: The robot's collision Rhino meshes (if any).
#   port attached_meshes: The attached collision Rhino meshes (if any).
#   port frames: The robot's joint frames as Rhino planes (if any).
#   port base_frame: The robot's base frame as a Rhino plane (if any).
#   port ee_frame: The robot's end-effector frame as a Rhino plane (if any).
# ---------- robot_visualize: Python ----------
"""
Visualizes the robot.

COMPAS FAB v0.19.1
"""
from compas.geometry import Frame
from compas.geometry import Transformation
from compas_ghpython.artists import FrameArtist
from compas_ghpython.artists import MeshArtist
from ghpythonlib.componentbase import executingcomponent as component


class RobotVisualize(component):
    def RunScript(self, robot, group, configuration, attached_collision_meshes, show_visual, show_collision,
                  show_frames, show_base_frame, show_end_effector_frame, show_acm):

        visual = None
        collision = None
        attached_meshes = None
        frames = None
        base_frame = None
        ee_frame = None

        if robot:
            show_visual = True if show_visual is None else show_visual
            configuration = configuration or robot.zero_configuration()

            robot.update(configuration, visual=show_visual, collision=show_collision)
            compas_frames = robot.transformed_frames(configuration, group)

            if show_visual:
                visual = robot.artist.draw_visual()

            if show_collision:
                collision = robot.artist.draw_collision()

            if show_base_frame:
                base_compas_frame = compas_frames[0]
                artist = FrameArtist(base_compas_frame)
                base_frame = artist.draw()

            if show_end_effector_frame:
                ee_compas_frame = robot.forward_kinematics(configuration, group, options=dict(solver='model'))
                artist = FrameArtist(ee_compas_frame)
                ee_frame = artist.draw()

            if show_frames:
                frames = []
                for compas_frame in compas_frames[1:]:
                    artist = FrameArtist(compas_frame)
                    frame = artist.draw()
                    frames.append(frame)

            if show_acm:
                attached_meshes = []
                for acm in attached_collision_meshes:
                    frame = robot.forward_kinematics(configuration, options=dict(solver='model', link_name=acm.link_name))
                    T = Transformation.from_frame_to_frame(Frame.worldXY(), frame)
                    mesh = acm.collision_mesh.mesh.transformed(T)
                    attached_meshes.append(MeshArtist(mesh).draw())

        return (visual, collision, attached_meshes, frames, base_frame, ee_frame)
# ---------- end robot_visualize ----------

# ---- group: plan path
constraints_from_plane_2 = ConstraintsFromPlane(robot=data_2, plane=pln_12, group=data_6)  # -> constraints
#   port plane: The plane or frame from which we create position and orientation constraints.
#   port group: The planning group for which we specify the constraint. Defaults to the robot's main planning group.
#   port tolerance_position: The allowed tolerance to the frame's position (defined in the robot's units). Defaults to 0.001
#   port tolerance_xaxis: The allowed tolerance of the frame's X-axis in degrees.
#   port tolerance_yaxis: The allowed tolerance of the frame's Y-axis in degrees.
#   port tolerance_zaxis: The allowed tolerance of the frame's Z-axis in degrees.
#   port constraints: A list containing a position and an orientation constraint.
# ---------- constraints_from_plane_2: Python ----------
"""
Create a position and an orientation constraint from a plane calculated for the group's end-effector link.

COMPAS FAB v0.19.1
"""
import math

from ghpythonlib.componentbase import executingcomponent as component

from compas_fab.ghpython.components import coerce_frame


class ConstraintsFromPlane(component):
    def RunScript(self, robot, plane, group, tolerance_position, tolerance_xaxis, tolerance_yaxis, tolerance_zaxis):
        goal_constraints = None
        if robot and plane:
            tolerance_position = tolerance_position or 0.001
            tolerance_xaxis = tolerance_xaxis or 1.
            tolerance_yaxis = tolerance_yaxis or 1.
            tolerance_zaxis = tolerance_zaxis or 1.

            frame = coerce_frame(plane)
            tolerances_axes = [math.radians(tolerance_xaxis), math.radians(tolerance_yaxis), math.radians(tolerance_zaxis)]
            goal_constraints = robot.constraints_from_frame(frame, tolerance_position, tolerances_axes, group)
            print goal_constraints
        return goal_constraints
# ---------- end constraints_from_plane_2 ----------
plan_motion = PlanMotion(robot=data_2, goal_constraints=constraints_from_plane_2, start_configuration=filter_6, group=data_6, compute=Button())  # -> trajectory; inputs goal_constraints: list, attached_collision_meshes: list of Mesh, path_constraints: list, compute: Boolean
#   port goal_constraints: The goal to be achieved, defined in a set of constraints. Constraints can be very specific, for example defining value domains for each joint, such that the goal configuration is included, or defining a volume in space, to which a specific robot link (e.g. the end-effector) is required to move to.
#   port start_configuration: The robot's full configuration, i.e. values for all configurable joints of the entire robot, at the starting position. Defaults to the all-zero configuration.
#   port group: The planning group used for calculation. Defaults to the robot's main planning group.
#   port attached_collision_meshes: A list of attached collision meshes to be included for planning.
#   port path_constraints: Optional constraints that can be imposed along the solution path. Note that path calculation won't work if the start_configuration violates these constraints. Defaults to None.
#   port planner_id: The name of the algorithm used for path planning. Defaults to 'RRTConnectkConfigDefault'
#   port compute: If True, calculates a trajectory.
#   port trajectory: The calculated trajectory.
# ---------- plan_motion: Python ----------
"""
Calculate a motion path.

COMPAS FAB v0.19.1
"""
from ghpythonlib.componentbase import executingcomponent as component
from scriptcontext import sticky as st

from compas_fab.ghpython.components import create_id


class PlanMotion(component):
    def RunScript(self, robot, goal_constraints, start_configuration, group, attached_collision_meshes, path_constraints, planner_id, compute):

        key = create_id(self, 'trajectory')

        path_constraints = list(path_constraints) if path_constraints else None
        attached_collision_meshes = list(attached_collision_meshes) if attached_collision_meshes else None
        planner_id = str(planner_id) if planner_id else 'RRTConnectkConfigDefault'

        if robot and robot.client and robot.client.is_connected and start_configuration and goal_constraints and compute:
            st[key] = robot.plan_motion(goal_constraints,
                                        start_configuration=start_configuration,
                                        group=group,
                                        options=dict(
                                            attached_collision_meshes=attached_collision_meshes,
                                            path_constraints=path_constraints,
                                            planner_id=planner_id,
                                        ))

        trajectory = st.get(key, None)
        return trajectory
# ---------- end plan_motion ----------
trajectory_visualize = TrajectoryVisualize(robot=data_2, group=data_6, trajectory=plan_motion)  # -> start_configuration, configurations, fraction, time, planes, P, V, A
#   port group: The planning group for which this trajectory was planned.
#   port trajectory: The calculated trajectory.
#   port start_configuration: The start configuration of the trajectory.
#   port configurations: The full configurations along the trajectory.
#   port fraction: Indicates the fraction of requested trajectory that was calculated, e.g. 1 means the full trajectory was found.
#   port time: The time which is needed to execute that trajectory at full speed.
#   port planes: The planes of the robot's end-effector.
#   port P: The positions along the trajectory
#   port V: The velocities along the trajectory
#   port A: The accelerations along the trajectory
# ---------- trajectory_visualize: Python ----------
"""
Visualizes a trajectory.

COMPAS FAB v0.19.1
"""
from compas_ghpython import draw_frame
from compas_ghpython import list_to_ghtree
from ghpythonlib.componentbase import executingcomponent as component


class TrajectoryVisualize(component):
    def RunScript(self, robot, group, trajectory):
        start_configuration = None
        configurations = []
        fraction = 0.
        time = 0.

        planes = []
        positions = []
        velocities = []
        accelerations = []

        if robot and trajectory:
            group = group or robot.main_group_name

            for c in trajectory.points:
                configurations.append(robot.merge_group_with_full_configuration(c, trajectory.start_configuration, group))
                frame = robot.forward_kinematics(c, group, options=dict(solver='model'))
                planes.append(draw_frame(frame))
                positions.append(c.positions)
                velocities.append(c.velocities)
                accelerations.append(c.accelerations)

            start_configuration = trajectory.start_configuration
            fraction = trajectory.fraction
            time = trajectory.time_from_start

        P = list_to_ghtree(list(zip(*positions)))
        V = list_to_ghtree(list(zip(*velocities)))
        A = list_to_ghtree(list(zip(*accelerations)))

        # return outputs if you have them; here I try it for you:
        return (start_configuration, configurations, fraction, time, planes, P, V, A)
# ---------- end trajectory_visualize ----------

# ----
# PATH PLANNING (START)
data_16 = Data(trajectory_visualize.configurations)

# ---- group: visualize robot path
item_4 = ListItem(List=data_16, Index=Slider(20, range=0..50), Wrap=False)
robot_visualize_2 = RobotVisualize(robot=data_2, configuration=item_4)  # -> visual, collision, attached_meshes, frames, base_frame, ee_frame; inputs attached_collision_meshes: list, show_visual: Boolean, show_collision: Boolean, show_frames: Boolean, show_base_frame: Boolean, show_end_effector_frame: Boolean, show_acm: Boolean; same code as robot_visualize

# ---- group: paths to send
python_15 = GhPythonScript(configs=data_16)  # -> out, r1_place, r2_place; inputs configs: list
# ---------- python_15: Python ----------
import math
import compas_rrc as rrc

#configs = configs
    
r1_place = []
r2_place = []
for c in configs:
    r1_axes = rrc.ExternalAxes(c['r1_cart_joint']*1000)
    r1_joints = rrc.RobotJoints(
        math.degrees(c['r1_joint_1']),
        math.degrees(c['r1_joint_2']),
        math.degrees(c['r1_joint_3']),
        math.degrees(c['r1_joint_4']),
        math.degrees(c['r1_joint_5']),
        math.degrees(c['r1_joint_6']),
    )
    
    r2_axes = rrc.ExternalAxes(c['r2_cart_joint']*1000)
    r2_joints = rrc.RobotJoints(
        math.degrees(c['r2_joint_1']),
        math.degrees(c['r2_joint_2']),
        math.degrees(c['r2_joint_3']),
        math.degrees(c['r2_joint_4']),
        math.degrees(c['r2_joint_5']),
        math.degrees(c['r2_joint_6']),
    )
    
    r1_place.append([r1_axes, r1_joints])
    r2_place.append([r2_axes, r2_joints])
# ---------- end python_15 ----------
data_17 = Data(python_15.r1_place)
data_18 = Data(python_15.r2_place)

# ----
data_19 = Data(data_18)
data_20 = Data(data_17)
item_5 = ListItem(List=data_19, Index="-1", Wrap=True)
item_6 = ListItem(List=data_20, Index="-1", Wrap=True)

# ---- group: 3. path plan (start)
button_4 = Button()
data_21 = Data(item_6)
data_22 = Data(item_5)

# ----
python_16 = GhPythonScript(
    ros=data_15,
    rob_num=panel_14,
    wobj=panel_15,
    return_config=data_9,
    send_return=button,
    r1_pick_path=data_10,
    r2_pick_path=data_11,
    pick_config=data_12,
    send_pick=button_2,
    r1_place_startpath=data_21,
    r2_place_startpath=data_22,
    send_place_start=button_4,
    r1_place_endpath=data_13,
    r2_place_endpath=data_14,
    send_place_end=button_3,
    get_info=Toggle(False))  # -> out, current_joints; inputs rob_num: Int32, r1_pick_path: list, r2_pick_path: list, r1_place_startpath: list, r2_place_startpath: list, r1_place_endpath: list, r2_place_endpath: list
# ---------- python_16: Python ----------
import compas_rrc as rrc
from compas.geometry import Frame
from compas.geometry import Plane

from compas_rhino.geometry import RhinoPlane

# Create ABB Client (rob2 = right, rob1 = left)
if rob_num == 1:
    abb = rrc.AbbClient(ros, '/rob1')
    abb.send(rrc.SetTool('ecl_pneumatic_gripper'))
    DO = 'do_1'
    pick_path = r1_pick_path
    path_place_s = r1_place_startpath
    path_place_e = r1_place_endpath
    #pick_track = 100
    
    print('Connected.')
elif rob_num == 2:
    abb = rrc.AbbClient(ros, '/rob2')
    abb.send(rrc.SetTool('ecl_pneumatic_gripper'))
    DO = 'do_2'
    pick_path = r2_pick_path
    path_place_s = r2_place_startpath
    path_place_e = r2_place_endpath
    #pick_track = 3888.11
    
    print('Connected.')

# Define speeds
speed = 100

# set wobj
abb.send(rrc.SetWorkObject(wobj))

if get_info:
    current_joints = abb.send_and_wait(rrc.GetJoints(),  timeout = 3)
    print current_joints
    

if send_return:
    
    if rob_num == 1:
        axis = rrc.ExternalAxes(return_config['r1_cart_joint'])
        joints = rrc.RobotJoints(
            return_config['r1_joint_1'],
            return_config['r1_joint_2'],
            return_config['r1_joint_3'],
            return_config['r1_joint_4'],
            return_config['r1_joint_5'],
            return_config['r1_joint_6'],
        )
    elif rob_num == 2:
        axis = rrc.ExternalAxes(return_config['r2_cart_joint'])
        joints = rrc.RobotJoints(
            return_config['r2_joint_1'],
            return_config['r2_joint_2'],
            return_config['r2_joint_3'],
            return_config['r2_joint_4'],
            return_config['r2_joint_5'],
            return_config['r2_joint_6'],
        )
        
    done = abb.send(rrc.MoveToJoints(joints, axis, speed, rrc.Zone.FINE))
    print('Finished')


if send_pick:
    #open gripper
    done = abb.send_and_wait(rrc.SetDigital(DO,0), timeout = 10)
    
    done = abb.send_and_wait(rrc.MoveToFrame(pick_path[0], speed, rrc.Zone.FINE), timeout = 30)
    future = abb.send(rrc.Stop(feedback_level=rrc.FeedbackLevel.DONE))
    
    done = abb.send_and_wait(rrc.MoveToFrame(pick_path[1], speed, rrc.Zone.FINE), timeout = 30)
    future = abb.send(rrc.Stop(feedback_level=rrc.FeedbackLevel.DONE))
        
    #close gripper
    done = abb.send_and_wait(rrc.SetDigital(DO,1), timeout = 10)
    
    #back to start frame
    done = abb.send_and_wait(rrc.MoveToFrame(pick_path[0], speed, rrc.Zone.FINE), timeout = 10)
    future = abb.send(rrc.Stop(feedback_level=rrc.FeedbackLevel.DONE))
    
    #Final hard-coded config, path planning starts from here
    if rob_num == 1:
        axis = rrc.ExternalAxes(pick_config['r1_cart_joint'])
        joints = rrc.RobotJoints(
            pick_config['r1_joint_1'],
            pick_config['r1_joint_2'],
            pick_config['r1_joint_3'],
            pick_config['r1_joint_4'],
            pick_config['r1_joint_5'],
            pick_config['r1_joint_6'],
        )
    elif rob_num == 2:
        axis = rrc.ExternalAxes(pick_config['r2_cart_joint'])
        joints = rrc.RobotJoints(
            pick_config['r2_joint_1'],
            pick_config['r2_joint_2'],
            pick_config['r2_joint_3'],
            pick_config['r2_joint_4'],
            pick_config['r2_joint_5'],
            pick_config['r2_joint_6'],
        )
        
    done = abb.send(rrc.MoveToJoints(joints, axis, speed, rrc.Zone.FINE))
    print('Finished')
    
    
if send_place_start:
    # execute planned path
    # formatted as RobotJoints and ExternalAxes object 
    
    last_axis, last_joints = path_place_s.pop(-1)
    
    for axis,joints in path_place_s:
        print axis, joints
        done = abb.send(rrc.MoveToJoints(joints, axis, speed, rrc.Zone.Z10))
    
    done = abb.send(rrc.MoveToJoints(last_joints, last_axis, speed, rrc.Zone.FINE))
    
    print('Finished')

if send_place_end:
    
    # execute planned path
    # formatted as RobotJoints and ExternalAxes object 
    
    last_axis, last_joints = path_place_e.pop(-1)
    
    for axis,joints in path_place_e:
        print axis, joints
        done = abb.send(rrc.MoveToJoints(joints, axis, speed/3, rrc.Zone.Z10))
        
    done = abb.send(rrc.MoveToJoints(last_joints, last_axis, speed/3, rrc.Zone.FINE))

    print('Finished')
# ---------- end python_16 ----------
panel_18 = Panel(python_16.out)
panel_19 = Panel(python_16.current_joints)
